# Grasshopper definition swifet_example.gh (Grasshopper 1.0.8)
# plug-ins: Swiftlet

define_tool_parameter = DefineToolParameter(Name="radius", Type="number", Description="Circle Radius", Required=True)
define_tool_parameter_2 = DefineToolParameter(Name="point_count", Type="number", Description="Point Count", Required=True)
define_tool_parameter_3 = DefineToolParameter(Name="radius", Type="number", Description="Cylinder Radius", Required=True)
define_tool_parameter_4 = DefineToolParameter(Name="Height", Type="number", Description="Cylinder Height", Required=True)
merge = Merge(Data1=define_tool_parameter, Data2=define_tool_parameter_2)
merge_2 = Merge(Data1=define_tool_parameter_3, Data2=define_tool_parameter_4)
define_tool = DefineTool(Name="make_random_circles", Description="Makes a bunch of circles in random locations", Parameters=merge)
panel = Panel(define_tool)
define_tool_2 = DefineTool(Name="make_cylinder", Description="Make a Cylinder", Parameters=merge_2)
merge_3 = Merge(Data1=define_tool, Data2=define_tool_2)
mcp_server = MCPServer(Port=3001, Tools=merge_3, ServerName="test_server")  # -> Make_random_circles, Make_cylinder
deconstruct_tool_call = DeconstructToolCall(Request=mcp_server.Make_random_circles)  # -> Request, Tool, Arguments
deconstruct_tool_call_2 = DeconstructToolCall(Request=mcp_server.Make_cylinder)  # -> Request, Tool, Arguments
get_json_object_key = GetJSONObjectKey(JObject=deconstruct_tool_call.Arguments, Key="radius")
get_json_object_key_2 = GetJSONObjectKey(JObject=deconstruct_tool_call.Arguments, Key="point_count")
get_json_object_key_3 = GetJSONObjectKey(JObject=deconstruct_tool_call_2.Arguments, Key="radius")
get_json_object_key_4 = GetJSONObjectKey(JObject=deconstruct_tool_call_2.Arguments, Key="Height")
read_json_value = ReadJSONValue(JValue=get_json_object_key)  # -> AsString, AsNumber, AsBool
read_json_value_2 = ReadJSONValue(JValue=get_json_object_key_2)  # -> AsString, AsNumber, AsBool
read_json_value_3 = ReadJSONValue(JValue=get_json_object_key_3)  # -> AsString, AsNumber, AsBool
read_json_value_4 = ReadJSONValue(JValue=get_json_object_key_4)  # -> AsString, AsNumber, AsBool
cylinder = Cylinder(Base=PlaneXY(0, 0, 0), Radius=read_json_value_3.AsNumber, Length=read_json_value_4.AsNumber)
populate_2d = Populate2D(Region={Plane=PlaneXY(0, 0, 0), Size=Domain2(u=0..20, v=0..10)}, Count=read_json_value_2.AsNumber, Seed=1)
cap_holes = CapHoles(Brep=cylinder)
circle = Circle(Plane=populate_2d, Radius=read_json_value.AsNumber)
volume = Volume(Geometry=cap_holes)  # -> Volume, Centroid
region_union = RegionUnion(Curves=circle)
area = Area(Geometry=region_union)  # -> Area, Centroid
concatenate = Concatenate(FragmentA="The volume of the Cylinder is: ", FragmentB=volume.Volume)
concatenate_2 = Concatenate(FragmentA="The total area of the region combined by al circles: ", FragmentB=area.Area)
create_json_value = CreateJSONValue(Value=concatenate)
create_json_object = CreateJSONObject(Keys="text_outcome", Values=create_json_value)
create_json_value_2 = CreateJSONValue(Value=concatenate_2)
create_json_object_2 = CreateJSONObject(Keys="text_outcome", Values=create_json_value_2)
mcp_tool_response = MCPToolResponse(Request=deconstruct_tool_call_2.Request, Content=create_json_object, IsError=False)
panel_2 = Panel(concatenate)
mcp_tool_response_2 = MCPToolResponse(Request=deconstruct_tool_call.Request, Content=create_json_object_2, IsError=False)
